# Dynamo graph Home.dyn (Dynamo 1.2.1.3083)

# group: Facility, Floor, Space and component categories
code_block = CodeBlock()
# ---------- code_block.designscript (15 lines) ----------
"Project Information";
"Levels";
"Rooms";
"Walls";
"Floors";
"Windows";
"Doors";
"Stairs";
"Railings";
"Casework";
"Furniture";
"Roofs";
"Structural Foundations";
"Ceilings";
"Structural Framing";
# ----------------------------------------

# group: COMPONENT - Casework
byName = Category.ByName(code_block.out10)  # frozen
all_elements_of_category = ElementsOfCategory(byName)
space = Custom[Element.Space](element=all_elements_of_category)  # This will retrieve the space in which an element is contained. (if available)
watch = Watch(all_elements_of_category)
parameters = Element.Parameters(watch)
string_from_array = FromArray()  # unwired: arg0
map = List.Map(list=parameters, f_x=string_from_array)
watch_2 = Watch(map)
code_block_2 = CodeBlock { 1; }
code_block_3 = CodeBlock { ","; }
insert = String.Insert(str=watch_2, index=code_block_2, toInsert=code_block_3)
room = Custom[Element.Room](element=all_elements_of_category)  # This node takes the input of all elements of category and reports back the associated room per element. Currently tested with casework, furniture and plumbing fixtures.
name = Room.Name(room)
code_block_4 = CodeBlock { 0; }
code_block_5 = CodeBlock { ",Room:"; }
insert_2 = String.Insert(str=name, index=code_block_4, toInsert=code_block_5)
insert_3 = String.Insert(str=insert, index=code_block_2, toInsert=insert_2)
uniqueId = Element.UniqueId(room)
main = ConsoleApplication2.Program.Main(uniqueId)
convert_net_guid_to_ifc_guid = Custom[Convert .NET Guid to IFC Guid](NET_Guids=main)
code_block_6 = CodeBlock { 0; }
code_block_7 = CodeBlock { "RoomGUID:"; }
insert_4 = String.Insert(str=convert_net_guid_to_ifc_guid, index=code_block_6, toInsert=code_block_7)
insert_5 = String.Insert(str=insert_3, index=code_block_2, toInsert=insert_4)
uniqueId_2 = Element.UniqueId(all_elements_of_category)
main_2 = ConsoleApplication2.Program.Main(uniqueId_2)
convert_net_guid_to_ifc_guid_2 = Custom[Convert .NET Guid to IFC Guid](NET_Guids=main_2)

# group: FACILITY
byName_2 = Category.ByName(code_block.out0)  # frozen
all_elements_of_category_2 = ElementsOfCategory(byName_2)
watch_3 = Watch(all_elements_of_category_2)
parameters_2 = Element.Parameters(watch_3)
string_from_array_2 = FromArray()  # unwired: arg0
map_2 = List.Map(list=parameters_2, f_x=string_from_array_2)
uniqueId_3 = Element.UniqueId(all_elements_of_category_2)
main_3 = ConsoleApplication2.Program.Main(uniqueId_3)
convert_net_guid_to_ifc_guid_3 = Custom[Convert .NET Guid to IFC Guid](NET_Guids=main_3)

facility = Dynamo_Neo4j_Connection_New_Development.COBie.Facility(map_2, convert_net_guid_to_ifc_guid_3)

# group: SPACE
byName_3 = Category.ByName(code_block.out2)
all_elements_of_category_3 = ElementsOfCategory(byName_3)
watch_4 = Watch(all_elements_of_category_3)
parameters_3 = Element.Parameters(watch_4)
string_from_array_3 = FromArray()  # unwired: arg0
map_3 = List.Map(list=parameters_3, f_x=string_from_array_3)
uniqueId_4 = Element.UniqueId(all_elements_of_category_3)
main_4 = ConsoleApplication2.Program.Main(uniqueId_4)
convert_net_guid_to_ifc_guid_4 = Custom[Convert .NET Guid to IFC Guid](NET_Guids=main_4)

space_2 = Dynamo_Neo4j_Connection_New_Development.COBie.Space(map_3, convert_net_guid_to_ifc_guid_4)

# group: COMPONENT - Furniture
byName_4 = Category.ByName(code_block.out9)  # frozen
all_elements_of_category_4 = ElementsOfCategory(byName_4)
watch_5 = Watch(all_elements_of_category_4)
parameters_4 = Element.Parameters(watch_5)
string_from_array_4 = FromArray()  # unwired: arg0
map_4 = List.Map(list=parameters_4, f_x=string_from_array_4)
watch_6 = Watch(map_4)
code_block_8 = CodeBlock { 1; }
code_block_9 = CodeBlock { ","; }
insert_6 = String.Insert(str=watch_6, index=code_block_8, toInsert=code_block_9)
room_2 = Custom[Element.Room](element=all_elements_of_category_4)
name_2 = Room.Name(room_2)
code_block_10 = CodeBlock { 0; }
code_block_11 = CodeBlock { ",Room:"; }
insert_7 = String.Insert(str=name_2, index=code_block_10, toInsert=code_block_11)
insert_8 = String.Insert(str=insert_6, index=code_block_8, toInsert=insert_7)
uniqueId_5 = Element.UniqueId(room_2)
main_5 = ConsoleApplication2.Program.Main(uniqueId_5)
convert_net_guid_to_ifc_guid_5 = Custom[Convert .NET Guid to IFC Guid](NET_Guids=main_5)
code_block_12 = CodeBlock { 0; }
code_block_13 = CodeBlock { "RoomGUID:"; }
insert_9 = String.Insert(str=convert_net_guid_to_ifc_guid_5, index=code_block_12, toInsert=code_block_13)
insert_10 = String.Insert(str=insert_8, index=code_block_8, toInsert=insert_9)
uniqueId_6 = Element.UniqueId(all_elements_of_category_4)
main_6 = ConsoleApplication2.Program.Main(uniqueId_6)
convert_net_guid_to_ifc_guid_6 = Custom[Convert .NET Guid to IFC Guid](NET_Guids=main_6)

component = Dynamo_Neo4j_Connection_New_Development.COBie.Component(insert_10, convert_net_guid_to_ifc_guid_6)
component_2 = Dynamo_Neo4j_Connection_New_Development.COBie.Component(insert_5, convert_net_guid_to_ifc_guid_2)

# group: FLOOR
byName_5 = Category.ByName(code_block.out1)  # frozen
all_elements_of_category_5 = ElementsOfCategory(byName_5)
watch_7 = Watch(all_elements_of_category_5)
parameters_5 = Element.Parameters(watch_7)
string_from_array_5 = FromArray()  # unwired: arg0
map_5 = List.Map(list=parameters_5, f_x=string_from_array_5)
uniqueId_7 = Element.UniqueId(all_elements_of_category_5)
main_7 = ConsoleApplication2.Program.Main(uniqueId_7)
convert_net_guid_to_ifc_guid_7 = Custom[Convert .NET Guid to IFC Guid](NET_Guids=main_7)

floor = Dynamo_Neo4j_Connection_New_Development.COBie.Floor(map_5, convert_net_guid_to_ifc_guid_7)
