# Dynamo graph TweetToDB_ReplyTweet.dyn (Dynamo 1.0.0.1180)

mentionTimeline = LINKBIM.Twitter.MentionTimeline()
watch = Watch(mentionTimeline)

# group: TwitterToDB
firstItem = List.FirstItem(watch)
string = StringInput("@FMSYSTEM_TEST")
split = String.Split(firstItem, string)
firstItem_2 = List.FirstItem(split)
string_from_object = FromObject(firstItem_2)
twitter = Dynamo_Neo4j_Connection_New_Development.COBie.Twitter(string_from_object)
watch_2 = Watch(twitter)
code_block = CodeBlock { 2; 127; }
substring = String.Substring(str=watch_2, startIndex=code_block.out0, length=code_block.out1)
code_block_2 = CodeBlock { "LIUXI_AALTO"; }
string_2 = StringInput("http://mytwitterid.com/LIUXI_AALTO")
web_request = WebRequest(string_2)
code_block_3 = CodeBlock { "<strong>"; }
code_block_4 = CodeBlock { "</strong></p>"; }
split_2 = String.Split(web_request, code_block_3, code_block_4)
code_block_5 = CodeBlock { 1; }
getItemAtIndex = List.GetItemAtIndex(list=split_2, index=code_block_5)
watch_3 = Watch(getItemAtIndex)
toNumber = String.ToNumber(watch_3)
replyTweet = LINKBIM.Twitter.ReplyTweet(substring, code_block_2, toNumber)
string_from_array = FromArray(split)
code_block_6 = CodeBlock { "{"; "}"; }
split_3 = String.Split(string_from_array, code_block_6.out0, code_block_6.out1)
