# Dynamo graph TwitterSample.dyn (Dynamo 1.0.0.1180)

select_model_element = DSModelElementSelection()  # 1 picked in the model
id = Element.Id(select_model_element)
byElementId = Archilab.Grimshaw.Selection.Select.ByElementId(id)
parameters = Element.Parameters(byElementId)
code_block = CodeBlock { "Twitter"; "100"; }
setParameterByName = Element.SetParameterByName(element=byElementId, parameterName=code_block.out0, value=code_block.out1)
select_model_element_2 = DSModelElementSelection()  # 1 picked in the model
faces = Element.Faces(select_model_element_2)
integer_slider = IntegerSlider(1, range=0..9 step 1)
getItemAtIndex = List.GetItemAtIndex(list=faces, index=integer_slider)
number = DoubleInput(1)
number_2 = DoubleInput(1)
getIsoline = Surface.GetIsoline(getItemAtIndex, number, number_2)
mentionTimeline = LINKBIM.Twitter.MentionTimeline()
watch = Watch(mentionTimeline)
firstItem = List.FirstItem(watch)
string_from_object = FromObject(firstItem)
string = StringInput("\"")
split = String.Split(string_from_object, string)
code_block_2 = CodeBlock { 1; }
getItemAtIndex_2 = List.GetItemAtIndex(list=split, index=code_block_2)
toNumber = String.ToNumber(getItemAtIndex_2)
number_3 = DoubleInput(0..1..#number, toNumber, lacing=Longest)
pointAtParameter = Curve.PointAtParameter(curve=getIsoline, param=number_3)
select_model_element_3 = DSModelElementSelection()  # 1 picked in the model
faces_2 = Element.Faces(select_model_element_3)
getItemAtIndex_3 = List.GetItemAtIndex(list=faces_2, index=integer_slider)
number_4 = DoubleInput(1)
number_5 = DoubleInput(1)
getIsoline_2 = Surface.GetIsoline(getItemAtIndex_3, number_4, number_5)
pointAtParameter_2 = Curve.PointAtParameter(curve=getIsoline_2, param=number_3)
byStartPointEndPoint = Line.ByStartPointEndPoint(startPoint=pointAtParameter, endPoint=pointAtParameter_2)
levels = Levels("Ref Beam system")
family_types = FamilyTypes("M_TJL Wood Open Web Joist:356mm")
beamByCurve = StructuralFraming.BeamByCurve(curve=byStartPointEndPoint, level=levels, structuralFramingType=family_types)
string_2 = StringInput("@")
string_3 = StringInput("@DFD  \"333  \"  fefedgd")
string_4 = StringInput("5")
mentionTimeline_2 = LINKBIM.Twitter.MentionTimeline()
mentionTimeline_3 = LINKBIM.Twitter.MentionTimeline()
