# Dynamo graph user ID output dynamo updated.dyn (Dynamo 1.0.0.1180)

getItemAtIndex = List.GetItemAtIndex()
string = StringInput("http://mytwitterid.com/")
mentionTimeline = LINKBIM.Twitter.MentionTimeline()
watch = Watch(mentionTimeline)
firstItem = List.FirstItem(watch)
string_2 = StringInput("?")
split = String.Split(firstItem, string_2)
concat = String.Concat(string, split)
code_block = CodeBlock { "First reply test"; }
code_block_2 = CodeBlock { "LIUXI_AALTO"; }
string_3 = StringInput("http://mytwitterid.com/LIUXI_AALTO")
web_request = WebRequest(string_3)
watch_2 = Watch(web_request)
code_block_3 = CodeBlock { "<strong>"; }
code_block_4 = CodeBlock { "</strong></p>"; }
split_2 = String.Split(watch_2, code_block_3, code_block_4)
watch_3 = Watch(split_2)
integer_slider = IntegerSlider(1, range=0..100 step 1)
getItemAtIndex_2 = List.GetItemAtIndex(list=watch_3, index=integer_slider)
watch_4 = Watch(getItemAtIndex_2)
toNumber = String.ToNumber(watch_4)
replyTweet = LINKBIM.Twitter.ReplyTweet(code_block, code_block_2, toNumber)
code_block_5 = CodeBlock { "First tweet publish test"; }
publishTweet = LINKBIM.Twitter.PublishTweet(code_block_5)
