# Dynamo graph user ID output.dyn (Dynamo 1.0.0.1180)

getItemAtIndex = List.GetItemAtIndex()
string = StringInput("http://mytwitterid.com/faaz")
web_request = WebRequest(string)
watch = Watch(web_request)
code_block = CodeBlock { "<strong>"; }
code_block_2 = CodeBlock { "</strong></p>"; }
split = String.Split(watch, code_block, code_block_2)
watch_2 = Watch(split)
integer_slider = IntegerSlider(1, range=0..100 step 1)
getItemAtIndex_2 = List.GetItemAtIndex(list=watch_2, index=integer_slider)
watch_3 = Watch(getItemAtIndex_2)
string_2 = StringInput("http://mytwitterid.com/")
concat = String.Concat(string_2)
